# Grasshopper definition assembled_speckle.gh (Grasshopper 1.0.7)
# plug-ins: Speckle 2, Bifocals, eleFront

# filter terrain
panel = Panel("BakedStudioMarsTopoMain")
# add actual units
panel_2 = Panel("UnitsRawVolumes")

# ---- group: BIMSC-PROJECT
# Send a message to James M. to add
# new materials. This list will be updated
# for all groups to have a common material
# library and common material names.
panel_3 = Panel("FRAGMENTS OF A MARTIAN ROSE")
bimsc_project = Text(panel_3)

# ---- group: FLOOR_LEVELS
# Set your 'Project' name, your 'Group'
# number, your 'Volume' Location that
# connect wirelessly.
series = Series(Start=0, Step=1, Count="5")
expression = Expression(x=series, Expression="Format(\"{0:00}\", x)")
# PROJECT
# INPUTS
concat = Concatenate(FragmentA="L", FragmentB=expression)  # -> simplify(graft(Result))
floor_levels = Text(concat)

# ----
reflay = ReferenceByLayer(LayerName="Pods", lightweight=False)
reflay_2 = ReferenceByLayer(LayerName="UnitsFloors", lightweight=False)
reflay_3 = ReferenceByLayer(LayerName="Floors", lightweight=False)
reflay_4 = ReferenceByLayer(LayerName="FloorsRefLayer", lightweight=False)
reflay_5 = ReferenceByLayer(LayerName="Roof", lightweight=False)
reflay_6 = ReferenceByLayer(LayerName="Wall", lightweight=False)
reflay_7 = ReferenceByLayer(LayerName="Contours", lightweight=False)
reflay_8 = ReferenceByLayer(LayerName="TopoMesh", lightweight=False)
reflay_9 = ReferenceByLayer(LayerName="TopoBrep", lightweight=False)
reflay_10 = ReferenceByLayer(LayerName=panel, lightweight=False)
reflay_11 = ReferenceByLayer(LayerName=panel_2, lightweight=False)

# ---- group: RECEIVE MATERIALS
# RECIEVE
# MATERIALS
panel_4 = Panel("https://macad.speckle.xyz/streams/4975f9f0a8/branches/site%2F05-materials")
receive = Receive(
    Stream=panel_4,
    AutoReceive=False,
    CurrentComponentState="up_to_date",
    ExpandOutput=True,
    LastInfoMessage="James McBennett @ 03/02/2024 01:57:29: Materials 01-03-2024 (id:6ecf38526e)",
    ReceiveOnOpen=False,
    ReceivedCommitId="6ecf38526e",
    StreamWrapper="https://macad.speckle.xyz/streams/4975f9f0a8/branches/site/05-materials",
    selectedKitName="Objects")  # -> Info, Materials
dso = DeconstructSpeckleObject(SpeckleObject=receive.Materials, selectedKitName="Objects")  # -> Glass, Inflatable, Insulation, Mineral, Regolith, Site, Soil, Steel

# ----
list = ValueList({"AngularDimension", "Arc", "Block", "Brep", "Circle", "Curve", "Dimension", "Ellipse", "Extrusion", "Hatch", "Leader", "Line", "LinearDimension", "Mesh", "Point", "Polyline", "Polysurface", "RadialDimension", "Surface", "Text", "TextDot"}, selected="Mesh")
panel_5 = Panel(reflay)

# ---- group: BIMSC-ORIGINATOR
bimsc_originator = Text("G06")

# ----
panel_6 = Panel(reflay_4)
panel_7 = Panel(reflay_2)
panel_8 = Panel(reflay_3)
panel_9 = Panel(reflay_5)
panel_10 = Panel(reflay_6)
panel_11 = Panel(reflay_7)
panel_12 = Panel(reflay_8)
panel_13 = Panel(reflay_11)
panel_14 = Panel(reflay_9)
panel_15 = Panel(reflay_10)
filtertype = FilterByType(ObjectType=list, Geometry=reflay_10, invertFilter=False, returnNulls=False)  # -> ExcludedGeometry, IncludedGeometry

# ---- group: BIMSC-VOLUME
bimsc_volume = Text("A4")

# ----
mesh = MeshBrep(
    Brep=reflay_4,
    Settings={GridMaxCount=0, GridMinCount=16, JaggedSeams=False, MaxEdgeLength=0, MinEdgeLength=0.0001, MinTolerance=0, Refine=True, RefineAngle=0, RelativeTolerance=0.65, SimplePlanes=True, Tolerance=0})
mesh_2 = MeshBrep(
    Brep=reflay_3,
    Settings={GridMaxCount=0, GridMinCount=16, JaggedSeams=False, MaxEdgeLength=0, MinEdgeLength=0.0001, MinTolerance=0, Refine=True, RefineAngle=0, RelativeTolerance=0.65, SimplePlanes=True, Tolerance=0})
mesh_3 = MeshBrep(
    Brep=reflay_2,
    Settings={GridMaxCount=0, GridMinCount=16, JaggedSeams=False, MaxEdgeLength=0, MinEdgeLength=0.0001, MinTolerance=0, Refine=True, RefineAngle=0, RelativeTolerance=0.65, SimplePlanes=True, Tolerance=0})
brep = Brep(reflay_4)
mesh_4 = MeshBrep(
    Brep=reflay,
    Settings={GridMaxCount=0, GridMinCount=16, JaggedSeams=False, MaxEdgeLength=0, MinEdgeLength=0.0001, MinTolerance=0, Refine=True, RefineAngle=0, RelativeTolerance=0.65, SimplePlanes=True, Tolerance=0})
brep_2 = Brep(reflay_2)
brep_3 = Brep(reflay_3)
mesh_5 = MeshBrep(
    Brep=reflay_11,
    Settings={GridMaxCount=0, GridMinCount=16, JaggedSeams=False, MaxEdgeLength=0, MinEdgeLength=0.0001, MinTolerance=0, Refine=True, RefineAngle=0, RelativeTolerance=0.65, SimplePlanes=True, Tolerance=0})
mesh_6 = MeshBrep(
    Brep=reflay_6,
    Settings={GridMaxCount=0, GridMinCount=16, JaggedSeams=False, MaxEdgeLength=0, MinEdgeLength=0.0001, MinTolerance=0, Refine=True, RefineAngle=0, RelativeTolerance=0.65, SimplePlanes=True, Tolerance=0})
brep_4 = Brep(reflay)
brep_5 = Brep(reflay_11)
brep_6 = Brep(reflay_6)
mesh_7 = MeshBrep(
    Brep=reflay_9,
    Settings={GridMaxCount=0, GridMinCount=16, JaggedSeams=False, MaxEdgeLength=0, MinEdgeLength=0.0001, MinTolerance=0, Refine=True, RefineAngle=0, RelativeTolerance=0.65, SimplePlanes=True, Tolerance=0})
brep_7 = Brep(reflay_9)
mesh_8 = Mesh(filtertype.IncludedGeometry)
faceb = FaceBoundaries(Mesh=mesh_8)
mesh_9 = Mesh(reflay_8)
mesh_10 = Mesh(reflay_5)
faceb_2 = FaceBoundaries(Mesh=mesh_10)
boundary = BoundarySurfaces(Edges=faceb)
faceb_3 = FaceBoundaries(Mesh=mesh_9)

# ---- group: WorksForBrepsAndMeshes
list_2 = ValueList({"Srf/Brep": 0, "Mesh": 1}, selected="Mesh")

# ----
mesh_11 = Mesh(mesh_8)
join = BrepJoin(Breps=boundary)  # -> Breps, Closed
boundary_2 = BoundarySurfaces(Edges=faceb_2)
boundary_3 = BoundarySurfaces(Edges=faceb_3)
join_2 = BrepJoin(Breps=boundary_2)  # -> Breps, Closed
srf = Surface([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])
mesh_12 = Mesh([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])
join_3 = BrepJoin(Breps=boundary_3)  # -> Breps, Closed
srf_2 = Surface(Tree({0}: [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], {1}: [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], {2}: [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], {3}: [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], {4}: [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]))
mesh_13 = Mesh(Tree({0}: [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], {1}: [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], {2}: [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], {3}: [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], {4}: [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]))
brep_8 = Brep(Tree({0}: [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], {1}: [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], {2}: [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], {3}: [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], {4}: [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]))
mesh_14 = Mesh(Tree({0}: [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], {1}: [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], {2}: [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], {3}: [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], {4}: [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]))

# ---- group: Alternative Method Using Extend Speckle Object by Key/Value / LEVEL
floor_levels_2 = Text(floor_levels)

# ---- group: Alternative Method Using Extend Speckle Object by Key/Value / PHASE
# ALTERNATIVE
num = Number(Tree({0}: [1], {1}: [1], {2}: [2], {3}: [2], {4}: [3]))

# ---- group: SiteCutCrv
crv = Curve(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)

# ---- group: NewSiteMesh
# SITE
mesh_15 = Mesh(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)

# ----
srf_3 = Surface(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)

merge = Merge(Data1=flatten(crv), Data2=flatten(mesh_15))  # -> simplify(graft(Result))
name = ExtendSpeckleObject(
    SpeckleObject=merge,
    BIMSCPROJECT=bimsc_project,
    BIMSCORIGINATOR=bimsc_originator,
    BIMSCVOLUME=bimsc_volume,
    BIMSCLEVEL="L00",
    BIMSCTYPE="SITE",
    BIMSCMATERIAL="SITE",
    RenderMaterial=dso.Site,
    BIMSCPHASE="1",
    selectedKitName="Objects")  # -> flatten(ExtendedSpeckleObject)

# ---- group: LEVEL
txt = Text(Tree({0}: ["L00"], {1}: ["L04"]))

# ---- group: PHASE
num_2 = Number(Tree({0}: [1], {1}: [3]))

# ----
# ASSIGN MATERIALS
# AND FILTERS
filter = StreamFilter(Gate=list_2, Stream0=srf, Stream1=mesh_12)  # -> reverse(simplify(graft(Stream)))
name_2 = ExtendSpeckleObject(
    SpeckleObject=filter,
    BIMSCPROJECT=bimsc_project,
    BIMSCORIGINATOR=bimsc_originator,
    BIMSCVOLUME=bimsc_volume,
    BIMSCLEVEL=txt,
    BIMSCTYPE="ROOF",
    BIMSCMATERIAL="REGOLITH",
    RenderMaterial=dso.Regolith,
    BIMSCPHASE=num_2,
    selectedKitName="Objects")

# ---- group: PHASE
num_3 = Number(Tree({0}: [1], {1}: [1], {2}: [2], {3}: [2], {4}: [3]))

# ---- group: LEVEL
floor_levels_3 = Text(floor_levels)

# ----
filter_2 = StreamFilter(Gate=list_2, Stream0=srf_2, Stream1=mesh_13)
name_3 = ExtendSpeckleObject(
    SpeckleObject=filter_2,
    BIMSCPROJECT=bimsc_project,
    BIMSCORIGINATOR=bimsc_originator,
    BIMSCVOLUME=bimsc_volume,
    BIMSCLEVEL=floor_levels_3,
    BIMSCTYPE="WINDOW",
    BIMSCMATERIAL="GLASS",
    RenderMaterial=dso.Glass,
    BIMSCPHASE=num_3,
    selectedKitName="Objects")  # -> flatten(ExtendedSpeckleObject)

# ---- group: Alternative Method Using Extend Speckle Object by Key/Value
# Alternative method using keys and
# values. You will need to 'cross reference'
# or 'repeat-duplicate' data to create the
# correct set of keys and values for your
# model as in panel on the right.
panel_16 = Panel("WINDOW")
crossref = CrossReference(
    ListBIMSCPROJECT=bimsc_project,
    ListBIMSCORIGINATOR=bimsc_originator,
    ListBIMSCVOLUME=bimsc_volume,
    ListBIMSCLEVEL=floor_levels_2,
    ListBIMSCTYPE=panel_16,
    ListBIMSCMATERIAL="GLASS",
    ListRenderMaterial=dso.Glass,
    ListBIMSCPHASE=num,
    CrossMode=1)  # -> ListBIMSCPROJECT, ListBIMSCORIGINATOR, ListBIMSCVOLUME, ListBIMSCLEVEL, ListBIMSCTYPE, ListBIMSCMATERIAL, ListRenderMaterial, ListBIMSCPHASE
merge_2 = Merge(
    Data1=crossref.ListBIMSCPROJECT,
    Data2=crossref.ListBIMSCORIGINATOR,
    Data3=crossref.ListBIMSCVOLUME,
    Data4=crossref.ListBIMSCLEVEL,
    Data5=crossref.ListBIMSCTYPE,
    Data6=crossref.ListBIMSCMATERIAL,
    Data7=crossref.ListRenderMaterial,
    Data8=crossref.ListBIMSCPHASE)
panel_17 = Panel("""BIMSC-PROJECT
BIMSC-ORIGINATOR
BIMSC-VOLUME
BIMSC-LEVEL
BIMSC-TYPE
BIMSC-MATERIAL
renderMaterial
BIMSC-PHASE""")
panel_18 = Panel(merge_2)
esokv = ExtendSpeckleObjectByKeyValue(SpeckleObject=filter_2, Keys=panel_17, Values=merge_2, selectedKitName="Objects")  # -> flatten(ExtendedSpeckleObject)

# ---- group: PHASE
num_4 = Number(Tree({0}: [1], {1}: [1], {2}: [2], {3}: [2], {4}: [3]))

# ---- group: LEVEL
floor_levels_4 = Text(floor_levels)

# ----
filter_3 = StreamFilter(Gate=list_2, Stream0=brep_8, Stream1=mesh_14)
lng = ListLength(List=filter_3)
series_2 = Series(Start=0, Step=1, Count=lng)
# If you would like to set your own
# Speckle Material Properties, do
# so with this component. You can
# use this setup to create gradients.
gradient = Gradient(
    LowerLimit=0,
    UpperLimit=lng,
    Parameter=series_2,
    stops=[0: RGB(234, 38, 0), 0.25: RGB(234, 126, 0), 0.5: RGB(254, 244, 84), 0.75: RGB(173, 203, 249), 1: RGB(75, 107, 169)])
sso = RenderMaterial(
    Opacity=Slider(1, range=0..1),
    Metalness=0,
    Roughness=1,
    Diffuse=gradient,
    SelectedConstructorName="Objects.Other.RenderMaterial.ctor(System.Double,System.Double,System.Double,System.Nullable`1[System.Drawing.Color],System.Nullable`1[System.Drawing.Color])",
    SelectedTypeName="Objects.Other.RenderMaterial",
    UseSchemaTag=False,
    UserSetSchemaTag=False,
    seed="8778421604ba247de87e")  # -> simplify(SpeckleObject)
name_4 = ExtendSpeckleObject(
    SpeckleObject=filter_3,
    BIMSCPROJECT=bimsc_project,
    BIMSCORIGINATOR=bimsc_originator,
    BIMSCVOLUME=bimsc_volume,
    BIMSCLEVEL=floor_levels_4,
    BIMSCTYPE="WALL",
    BIMSCMATERIAL="REGOLITH",
    RenderMaterial=sso,
    BIMSCPHASE=num_4,
    selectedKitName="Objects")  # -> flatten(ExtendedSpeckleObject)

panel_19 = Panel("https://macad.speckle.xyz/streams/4975f9f0a8/branches/site/04-community-site")
receive_2 = Receive(
    Stream=panel_19,
    AutoReceive=False,
    CurrentComponentState="up_to_date",
    ExpandOutput=True,
    LastInfoMessage="James McBennett @ 03/01/2024 23:14:17: 2024 Mar-01 (id:9ec35295b2)",
    ReceiveOnOpen=False,
    ReceivedCommitId="9ec35295b2",
    StreamWrapper="https://macad.speckle.xyz/streams/4975f9f0a8/branches/site/04-community-site",
    selectedKitName="Objects")  # -> Info, CONTOURS, SOIL
# EDIT SITE MESH
item = ListItem(List=flatten(receive_2.SOIL), Index=Slider(3, range=0..17), Wrap=True)
bbox = BoundingBox(Content=srf_3, Plane=PlaneXY(0, 0, 0))  # -> Box, Box_2
volume = Volume(Geometry=bbox.Box)  # -> Volume, Centroid
msphere = MeshSphere(Base=volume.Centroid, Radius="30000", UCount="100", VCount="100")
msplit = MeshSplit(Mesh=item, Splitters=msphere)

mmx = MeshMesh(MeshA=item, MeshB=msphere)

# ----
# SEND
panel_20 = Panel("https://macad.speckle.xyz/streams/fb7821e9f3/branches/main")
cso = CreateSpeckleObject(ROOF=name_2, WALL=name_4, WINDOW=name_3, SITE=name, selectedKitName="Objects")
send = Send(
    Stream=panel_20,
    Message="Test",
    D=cso,
    AutoSend=False,
    BaseId="6a982903f45783bb54a2832a9ef6a595",
    CurrentComponentState="expired",
    KitName="Objects",
    OutputWrappers="https://macad.speckle.xyz\tfb7821e9f3\tcd98566eea",
    UseDefaultCache=True,
    selectedKitName="Objects")
